# Grasshopper definition Python3NumPy.gh (Grasshopper 1.0.7)
# plug-ins: RhinoCodePluginGH

S = Script()  # -> out, a
# ---------- S: Python ----------
"""Grasshopper Script"""
a = "Hello Python 3 in Grasshopper!"
print(a)
import sys
print(sys.version)
print(sys.path)
print(sys.executable)

#https://discourse.mcneel.com/t/rhino-8-feature-scripteditor-cpython-csharp/128353/425

#https://discourse.mcneel.com/t/rhino-8-feature-scripteditor-cpython-csharp/128353/437?u=pirouz_nourian1
"""Testing pip install specific packages"""
# r: numpy

import numpy as np
print(np.__version__)

print(np.zeros((3,3)))
# ---------- end S ----------
